# Grasshopper definition geometry2json.gh (Grasshopper 1.0.7)

curve = Curve([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])
explode = Explode(Curve=curve, Recursive=True)  # -> Segments, Vertices
area = Area(Geometry=curve)  # -> Area, Centroid
shift_list = ShiftList(List=explode.Vertices, Shift="1", Wrap=False)
vector_2pt = Vector2Pt(PointA=graft(area.Centroid), PointB=shift_list, Unitize=False)  # -> simplify(Vector), simplify(Length)
line = Line(StartPoint=shift_list, EndPoint=graft(area.Centroid))
ghpython_script = GhPythonScript(v=vector_2pt.Vector)  # -> out, a; inputs v: tree of Vector3d
# ---------- ghpython_script: Python ----------
import Rhino.Geometry as rg
import json

#data = [ { 'a' : 1, 'b' : 2, 'c' : 3, 'd' : 4, 'e' : 5 } ]
edges = []

for index in range(v.BranchCount):
    edge = v.Branch(index)
    edge_to_append = {"index" : index}
    vertices = []
    for vertex in edge:
        vertices.append([vertex.X, vertex.Y, vertex.Z])
    edge_to_append["vertices"] = vertices
    edges.append(edge_to_append)

#print edges
json = json.dumps(edges, sort_keys=True, indent=4, separators=(',', ': '))
a = json
# ---------- end ghpython_script ----------
sort_list = SortList(Keys=vector_2pt.Length, ValuesA=vector_2pt.Vector)  # -> Keys, ValuesA
panel = Panel(ghpython_script.a)
list_item = ListItem(List=sort_list.ValuesA, Index="0", Wrap=True)  # -> flatten(Item)
construct_plane = ConstructPlane(Origin=area.Centroid, XAxis=list_item, YAxis=Vector(0, 1, 0))
